# Dynamo graph Revit fingerprint MVP.dyn (Dynamo 3.3.0.6316)
# packages: Clockwork for Dynamo 2.x 2.3.0

directory_path = Directory("")
code_block = CodeBlock { "runner,domains,core"; }
toggle = BoolSelector(true)
python_script = Python(IN[0]=code_block, IN[3]=toggle)  # CPython3; unwired: IN[1], IN[2]
# ---------- python_script.python (128 lines) ----------
# -*- coding: utf-8 -*-
"""
Standalone Dynamo Python-node helper to purge selected entries from sys.modules
between runs, so edited project modules are re-imported without restarting Revit.

Intended for testing/development only.

Dynamo inputs (optional):
- IN[0]: prefixes to purge (string "a,b" or list). Default: [] (purge all non-protected)
- IN[1]: exact module names to purge (string "a,b" or list). Default: []
- IN[2]: dry run flag (True/False). Default: False

Dynamo output:
- OUT: dict with removed modules and counts
"""

import sys


# Conservative denylist: do not touch these roots.
_PROTECTED_ROOTS = set([
    "sys",
    "os",
    "json",
    "math",
    "clr",
    "Autodesk",
    "Revit",
    "RevitServices",
    "RevitNodes",
    "ProtoGeometry",
    "__main__",
])


def _to_list(value):
    if value is None:
        return []
    if isinstance(value, (list, tuple, set)):
        return [str(v).strip() for v in value if str(v).strip()]
    s = str(value).strip()
    if not s:
        return []
    return [p.strip() for p in s.split(",") if p.strip()]


def _to_bool(value, default=False):
    if value is None:
        return default
    if isinstance(value, bool):
        return value
    try:
        if isinstance(value, (int, float)):
            return bool(int(value))
    except Exception:
        pass
    s = str(value).strip().lower()
    if s in ("1", "true", "t", "yes", "y", "on"):
        return True
    if s in ("0", "false", "f", "no", "n", "off"):
        return False
    return default


def _is_protected(module_name):
    root = module_name.split(".", 1)[0]
    return root in _PROTECTED_ROOTS


def purge_modules(prefixes, exact_names, dry_run=False):
    prefixes = tuple(prefixes)
    exact_names = set(exact_names)
    purge_all = (not prefixes and not exact_names)

    to_remove = []
    for name in list(sys.modules.keys()):
        if not name or _is_protected(name):
            continue

        matched = (
            purge_all
            or name in exact_names
            or any(name == p or name.startswith(p + ".") for p in prefixes)
        )
        if matched:
            to_remove.append(name)

    # Remove deep modules first for cleaner dependency reloads.
    to_remove.sort(key=lambda n: (-n.count("."), n))

    removed = []
    errors = {}
    if not dry_run:
        for name in to_remove:
            try:
                sys.modules.pop(name, None)
                removed.append(name)
            except Exception as exc:
                errors[name] = str(exc)

    return {
        "status": "dry_run" if dry_run else "ok",
        "purge_all": purge_all,
        "prefixes": list(prefixes),
        "exact_names": sorted(list(exact_names)),
        "matched_count": len(to_remove),
        "removed_count": 0 if dry_run else len(removed),
        "error_count": len(errors),
        "removed_modules": [] if dry_run else removed,
        "matched_modules": to_remove if dry_run else [],
        "errors": errors,
        "note": "Development helper only. Avoid in production graphs.",
    }


try:
    _in = IN if "IN" in globals() else []
    _prefixes = _to_list(_in[0]) if len(_in) > 0 else []
    _exact = _to_list(_in[1]) if len(_in) > 1 else []
    _dry_run = _to_bool(_in[2], default=False) if len(_in) > 2 else False

    OUT = purge_modules(_prefixes, _exact, dry_run=_dry_run)
except Exception as exc:
    OUT = {
        "status": "error",
        "error": str(exc),
        "note": "Check IN values and retry.",
    }
# ----------------------------------------
passthrough = Custom[Passthrough](passThrough=directory_path, waitFor=python_script)  # package Clockwork for Dynamo 2.x; Forces a sequential order of execution. The node wired into the output of the Passthrough node will be executed *after* the node wired into the waitFor input (e.g. important for some Revit operations). The value of the passThrough input will be passed on to the node wired into the output port of the Passthrough node.
force_full_out = BoolSelector(false)
timestamp = BoolSelector(false)
code_block_2 = CodeBlock { "dev"; "production"; }
python_script_2 = Python(IN[0]=passthrough, IN[1]=force_full_out, IN[2]=timestamp, IN[4]=code_block_2.out1)  # CPython3; unwired: IN[3], IN[5]
# ---------- python_script_2.python (591 lines) ----------
import sys
import os
import traceback
import json

# Explicitly request semantic (v2) hashing

import importlib

# Provide output path to imported runner via env var (import boundary safe)
try:
    if IN is not None and len(IN) > 0 and IN[0] is not None and str(IN[0]).strip():
        os.environ["REVIT_FINGERPRINT_OUTPUT_PATH"] = str(IN[0]).strip()
    else:
        os.environ.pop("REVIT_FINGERPRINT_OUTPUT_PATH", None)
except Exception as e:
    os.environ.pop("REVIT_FINGERPRINT_OUTPUT_PATH", None)

# Optional: control which output surfaces are written
# Values: "all", "minimal", or comma list e.g. "payload,manifest"
try:
    os.environ["REVIT_FINGERPRINT_OUTPUT_SURFACES"] = "payload"
except Exception:
    pass

# Optional: IN[1] == True forces full OUT (debug/back-compat)
try:
    if IN is not None and len(IN) > 1 and bool(IN[1]) is True:
        os.environ["REVIT_FINGERPRINT_FORCE_FULL_OUT"] = "1"
    else:
        os.environ.pop("REVIT_FINGERPRINT_FORCE_FULL_OUT", None)
except Exception as e:
    os.environ.pop("REVIT_FINGERPRINT_FORCE_FULL_OUT", None)

# Optional: IN[2] controls whether a timestamp is appended to output filenames
#  - True / 1 / "true"  => stamp ON  (REVIT_FINGERPRINT_FILENAME_STAMP=1)
#  - False / 0 / "false" => stamp OFF (REVIT_FINGERPRINT_FILENAME_STAMP=0)
#  - Missing/None => stamp OFF (safer for batch determinism)
#  - Unparseable => stamp OFF + warning
_thinrunner_warnings = []

# Install path segments (centralized)
# Override REVIT_FINGERPRINT_ORG_DIR to change "Company" without editing the graph.
try:
    ORG_DIR = str(os.environ.get("REVIT_FINGERPRINT_ORG_DIR", "Company")).strip() or "Company"
except Exception:
    ORG_DIR = "Company"

APP_DIR = "RevitFingerprint"
CHANNEL_DIR = "current"

def _parse_boolish(v):
    if v is None:
        return None
    if isinstance(v, bool):
        return v
    try:
        # Dynamo sometimes gives int-like values
        if isinstance(v, (int, float)) and int(v) == v:
            return bool(int(v))
    except Exception:
        pass
    try:
        s = str(v).strip()
    except Exception:
        return None
    if not s:
        return None
    sl = s.lower()
    if sl in ("1", "true", "t", "yes", "y", "on"):
        return True
    if sl in ("0", "false", "f", "no", "n", "off"):
        return False
    return None

try:
    raw_in2 = None
    have_in2 = (IN is not None and len(IN) > 2)
    if have_in2:
        raw_in2 = IN[2]

    stamp_choice = _parse_boolish(raw_in2) if have_in2 else None

    if stamp_choice is True:
        os.environ["REVIT_FINGERPRINT_FILENAME_STAMP"] = "1"
    elif stamp_choice is False:
        os.environ["REVIT_FINGERPRINT_FILENAME_STAMP"] = "0"
    else:
        # Missing/None/unparseable => default OFF
        os.environ["REVIT_FINGERPRINT_FILENAME_STAMP"] = "0"
        if have_in2 and raw_in2 is not None:
            _thinrunner_warnings.append(
                "IN[2] unparseable for timestamp flag; defaulting REVIT_FINGERPRINT_FILENAME_STAMP=0"
            )
except Exception:
    # Default OFF on any thinrunner failure here
    os.environ["REVIT_FINGERPRINT_FILENAME_STAMP"] = "0"

# Optional: IN[4] controls dev/production output mode
#  - "dev"                => full output, human-readable indent, layer_rows preserved
#  - "production" / "prod" => compact serialization, detail surfaces suppressed
#  - Missing/None/empty   => default to "production" (safer for corpus runs)
#  - Unparseable          => env var not set + warning (run_dynamo defaults to production)
#
# NOTE: IN[3] is reserved for .dyn graph-path probing (see _iter_dyn_path_candidates).
#       The output mode flag occupies IN[4] to avoid conflicting with that usage.
try:
    raw_in4 = None
    have_in4 = (IN is not None and len(IN) > 4)
    if have_in4:
        raw_in4 = IN[4]

    if raw_in4 is None or (isinstance(raw_in4, str) and not raw_in4.strip()):
        # Missing / None / empty string => production default
        os.environ["REVIT_FINGERPRINT_OUTPUT_MODE"] = "production"
    else:
        try:
            _mode_raw = str(raw_in4).strip().lower()
            if _mode_raw == "dev":
                os.environ["REVIT_FINGERPRINT_OUTPUT_MODE"] = "dev"
            elif _mode_raw in ("production", "prod"):
                os.environ["REVIT_FINGERPRINT_OUTPUT_MODE"] = "production"
            else:
                # Unparseable: leave env var absent so run_dynamo applies its own default
                os.environ.pop("REVIT_FINGERPRINT_OUTPUT_MODE", None)
                _thinrunner_warnings.append(
                    "IN[4] unparseable for output mode ('{}'): "
                    "REVIT_FINGERPRINT_OUTPUT_MODE not set; run_dynamo will default to production".format(raw_in4)
                )
        except Exception:
            os.environ.pop("REVIT_FINGERPRINT_OUTPUT_MODE", None)
            _thinrunner_warnings.append(
                "IN[4] error parsing output mode; "
                "REVIT_FINGERPRINT_OUTPUT_MODE not set; run_dynamo will default to production"
            )
except Exception:
    # Safe default: production on any thinrunner failure
    os.environ["REVIT_FINGERPRINT_OUTPUT_MODE"] = "production"

# Optional: IN[5] provides the deployment config path (an operator-owned JSON
# file living outside this repo -- see docs/DEPLOYMENT_CONFIGURATION.md).
# Forwarded via REVIT_FINGERPRINT_DEPLOYMENT_CONFIG, the same operator/
# environment boundary runner.extraction_context.operator_deployment_config_path()
# already reads, so the file's contents (deployment-authored parameter names/
# GUIDs) never need to be hardcoded into this pasted graph node or checked
# into source control -- only the local file path is passed through here.
#
# Unlike IN[0]/IN[1]/IN[2]/IN[4] (which thin_runner fully owns), this variable
# has a second supported source: a machine/user environment variable set once
# outside this graph (docs/DEPLOYMENT_CONFIGURATION.md). A blank/disconnected
# IN[5] must fall back to whatever THAT was -- not to whatever a prior run of
# this same pasted node happened to set. Revit/Dynamo keeps this CPython
# process alive across repeated Play-button runs within one session (see the
# sys.modules reload dance below, which exists for the same reason), so a
# plain "set on non-blank, else leave alone" would leak one file's
# node-supplied config into the next file's extraction once IN[5] is later
# blanked without restarting Revit. Snapshot whatever was inherited exactly
# once per process, in private env vars that survive re-runs the same way
# sys.modules does, and restore -- never just leave stale -- whenever IN[5]
# stops supplying an override.
_DEPLOY_CFG_VAR = "REVIT_FINGERPRINT_DEPLOYMENT_CONFIG"
_DEPLOY_CFG_INHERITED_FLAG = "_REVIT_FINGERPRINT_DEPLOYMENT_CONFIG_INHERITED_PRESENT"
_DEPLOY_CFG_INHERITED_VALUE = "_REVIT_FINGERPRINT_DEPLOYMENT_CONFIG_INHERITED_VALUE"
try:
    if _DEPLOY_CFG_INHERITED_FLAG not in os.environ:
        if _DEPLOY_CFG_VAR in os.environ:
            os.environ[_DEPLOY_CFG_INHERITED_FLAG] = "1"
            os.environ[_DEPLOY_CFG_INHERITED_VALUE] = os.environ[_DEPLOY_CFG_VAR]
        else:
            os.environ[_DEPLOY_CFG_INHERITED_FLAG] = "0"

    if IN is not None and len(IN) > 5 and IN[5] is not None and str(IN[5]).strip():
        os.environ[_DEPLOY_CFG_VAR] = str(IN[5]).strip()
    elif os.environ.get(_DEPLOY_CFG_INHERITED_FLAG) == "1":
        os.environ[_DEPLOY_CFG_VAR] = os.environ.get(_DEPLOY_CFG_INHERITED_VALUE, "")
    else:
        os.environ.pop(_DEPLOY_CFG_VAR, None)
except Exception:
    pass

# MUST be the repo root that contains: core/, domains/, runner/
# Dynamo-node safe behavior:
#  - No __file__ reliance (this code is pasted into a Dynamo Python node)
#  - Repo root is discovered from env var or conventional local install paths
#  - Hard block if repo appears to be on SharePoint/OneDrive sync or UNC/network path

def _looks_like_unc_path(p):
    try:
        s = str(p)
    except Exception:
        return False
    return s.startswith("\\\\")

def _is_probably_sync_path(p):
    """
    Heuristic, Windows-centric: previously used to hard-block sync paths.
    Retained for detection only — callers decide whether to block or warn.
    """
    try:
        s = os.path.abspath(str(p))
    except Exception:
        return False

    sl = s.lower()

    # Common sync markers
    for m in ("\\onedrive\\", "\\sharepoint\\", "\\microsoft teams\\"):
        if m in sl:
            return True

    # Some orgs sync SharePoint under Documents with tenant/library naming
    if "\\documents\\" in sl and ("- sharepoint" in sl or "sharepoint" in sl):
        return True

    return False

def _is_repo_root(p):
    expected_local = [
        os.path.join(p, "runner", "run_dynamo.py"),
        os.path.join(p, "domains"),
        os.path.join(p, "core"),
    ]
    missing_local = [x for x in expected_local if not os.path.exists(x)]
    return (len(missing_local) == 0), missing_local

def _iter_dyn_path_candidates():
    out = []
    seen = set()
    probe_notes = []

    def _normalize_host_path(raw):
        s = str(raw or "").strip()
        if not s:
            return s

        # Trim wrapping quotes often injected by host shells.
        if (s.startswith('"') and s.endswith('"')) or (s.startswith("'") and s.endswith("'")):
            s = s[1:-1].strip()

        # file:// URI support
        if s.lower().startswith("file:///"):
            s = s[8:].replace("/", os.sep)

        # Windows device paths:
        #   \\?\C:\path -> C:\path
        #   \\?\UNC\server\share\path -> \\server\share\path (preserve UNC absoluteness)
        sl = s.lower()
        if sl.startswith("\\\\?\\unc\\"):
            s = "\\\\" + s[8:]
        elif sl.startswith("\\\\?\\"):
            s = s[4:]

        return s

    def _add(src, value):
        # Ignore common non-path control values from Dynamo node inputs.
        if isinstance(value, bool):
            return
        try:
            raw = _normalize_host_path(value)
        except Exception:
            return
        if not raw:
            return
        rlow = raw.strip().lower()
        if rlow in ("true", "false", "none", "null"):
            return

        try:
            v = os.path.abspath(raw)
        except Exception:
            return
        if not v:
            return

        # This collector is DYN-centric by design:
        # - accept explicit .dyn files
        # - accept directories (caller may provide a containing folder)
        # - reject non-.dyn files (e.g., .rvt) so we do not anchor root discovery
        #   to a Revit model path.
        vl = v.lower()
        if os.path.isfile(v) and (not vl.endswith(".dyn")):
            return
        if (not os.path.exists(v)) and (os.path.splitext(vl)[1] not in ("", ".dyn")):
            return

        k = v.lower()
        if k in seen:
            return
        seen.add(k)
        out.append((src, v))

    def _probe_dynamo_workspace_path():
        """
        Best-effort probe for currently running Dynamo workspace path.
        Returns a list of (source, value) tuples; value may be empty.
        """
        found = []

        # Preferred API path.
        try:
            import clr  # type: ignore
            for _asm in ("DynamoServices", "DynamoCore"):
                try:
                    clr.AddReference(_asm)
                except Exception:
                    pass

            try:
                from Dynamo.Events import ExecutionEvents  # type: ignore

                _sess = getattr(ExecutionEvents, "ActiveSession", None)
                _p = getattr(_sess, "CurrentWorkspacePath", None) if _sess is not None else None
                found.append(("auto:dynamo_executionevents_currentworkspace", _p))
            except Exception as _e:
                probe_notes.append("ExecutionEvents import probe failed: {}".format(_e))
        except Exception as _e:
            probe_notes.append("clr/DynamoServices probe unavailable: {}".format(_e))

        # Reflection fallback for environments where namespace import differs.
        try:
            import System  # type: ignore
            _ad = System.AppDomain.CurrentDomain
            _assemblies = list(_ad.GetAssemblies())
            _etype = None
            for _a in _assemblies:
                try:
                    _t = _a.GetType("Dynamo.Events.ExecutionEvents")
                except Exception:
                    _t = None
                if _t is not None:
                    _etype = _t
                    break
            if _etype is not None:
                _flags = System.Reflection.BindingFlags.Public | System.Reflection.BindingFlags.Static
                _active_prop = _etype.GetProperty("ActiveSession", _flags)
                _sess = _active_prop.GetValue(None, None) if _active_prop is not None else None
                _p = None
                if _sess is not None:
                    _spath = _sess.GetType().GetProperty("CurrentWorkspacePath")
                    _p = _spath.GetValue(_sess, None) if _spath is not None else None
                found.append(("auto:dynamo_executionevents_reflection", _p))
        except Exception as _e:
            probe_notes.append("ExecutionEvents reflection probe failed: {}".format(_e))

        return found

    # Auto-discovery (best effort): use current process context as "current graph"
    # starting point when explicit graph path is unavailable.
    try:
        cwd = os.getcwd()
    except Exception:
        cwd = ""
    if cwd:
        try:
            dyns = [x for x in os.listdir(cwd) if str(x).lower().endswith(".dyn")]
            if len(dyns) == 1:
                _add("auto:cwd_single_dyn", os.path.join(cwd, dyns[0]))
        except Exception:
            pass

    # Some hosts include an opened .dyn path on argv.
    try:
        for a in list(sys.argv):
            s = str(a or "").strip()
            if s.lower().endswith(".dyn"):
                _add("auto:argv_dyn", s)
    except Exception:
        pass

    for src, v in _probe_dynamo_workspace_path():
        _add(src, v)

    # Explicit overrides from host/invoker
    for k in (
        "REVIT_FINGERPRINT_DYN_PATH",
        "DYNAMO_GRAPH_PATH",
        "DYNAMO_FILE_PATH",
    ):
        try:
            v = str(os.environ.get(k, "")).strip()
        except Exception:
            v = ""
        if v:
            _add("env:{}".format(k), v)

    # Optional thin-runner input extension: IN[3] = .dyn path or containing folder
    try:
        if IN is not None and len(IN) > 3 and IN[3] is not None:
            v = str(IN[3]).strip()
            if v:
                _add("in:IN[3]", v)
    except Exception:
        pass

    global _DYN_PROBE_NOTES
    _DYN_PROBE_NOTES = probe_notes
    return out

def _nearest_repo_root_from_path(p, max_up=64):
    try:
        cur = os.path.abspath(str(p))
    except Exception:
        return None

    # Treat explicit *.dyn values as file paths even if the host has not
    # materialized them on disk yet (some Dynamo host surfaces provide
    # unresolved/current-document values).
    if str(cur).lower().endswith(".dyn") or os.path.isfile(cur):
        cur = os.path.dirname(cur)

    steps = 0
    while steps <= int(max_up):
        ok, missing = _is_repo_root(cur)
        if ok:
            return cur
        parent = os.path.dirname(cur)
        if parent == cur:
            break
        cur = parent
        steps += 1
    return None

def _candidate_repo_dirs():
    tried = []
    global _DYN_CANDIDATES, _DYN_PROBE_NOTES
    _DYN_CANDIDATES = []
    _DYN_PROBE_NOTES = []

    # 0) If a Dynamo graph path is known, discover the nearest repo root upward
    # from the .dyn file/folder location.
    for src, p in _iter_dyn_path_candidates():
        _DYN_CANDIDATES.append({"source": src, "path": p})
        # Keep the original graph-derived candidate visible in diagnostics even
        # when it is not itself a repo root.
        tried.append((src + ":graph_path_candidate", p))
        rr = _nearest_repo_root_from_path(p)
        if rr:
            tried.append((src + ":nearest_repo_root", rr))

    # 1) Optional override: power users can set this once
    try:
        v = os.environ.get("REVIT_FINGERPRINT_REPO_DIR", "")
    except Exception:
        v = ""
    v = str(v).strip()
    if v:
        tried.append(("env:REVIT_FINGERPRINT_REPO_DIR", v))

    # 2) Preferred per-user install location (Documents)
    # NOTE: Documents is sometimes redirected into OneDrive/SharePoint.
    # We will still *search* here, but runtime will be BLOCKED if it looks synced.
    up = os.environ.get("USERPROFILE", "")
    if up:
        tried.append(("documents:current", os.path.join(up, "Documents", ORG_DIR, APP_DIR, CHANNEL_DIR)))

    # 3) Fallback: LocalAppData (less visible, usually not synced)
    lad = os.environ.get("LOCALAPPDATA", "")
    if lad:
        tried.append(("localappdata:current", os.path.join(lad, ORG_DIR, APP_DIR, CHANNEL_DIR)))

    # 4) Fallback: legacy-ish user profile location
    if up:
        tried.append(("userprofile:RevitFingerprint_current", os.path.join(up, "RevitFingerprint", "current")))

    return tried

_selected = None
_tried = []
for src, p in _candidate_repo_dirs():
    if not p:
        continue
    repo_dir = os.path.abspath(str(p))
    _tried.append({"source": src, "path": repo_dir})

    unc = _looks_like_unc_path(repo_dir)
    sync = _is_probably_sync_path(repo_dir)

    ok, missing = _is_repo_root(repo_dir)
    if ok and not unc:
        _selected = {"repo_dir": repo_dir, "source": src}
        if sync:
            _selected["warnings"] = ["repo_dir_looks_like_sharepoint_onedrive_sync"]
        break

if _selected is None:
    OUT = {
        "status": "blocked",
        "error": "Local install not found (or only found in unsafe locations).",
        "expected_install": {
            "recommended_current": r"%USERPROFILE%\Documents\{ORG}\{APP}\{CH}".format(ORG=ORG_DIR, APP=APP_DIR, CH=CHANNEL_DIR),
            "zip_extract_example": r"%USERPROFILE%\Documents\{ORG}\{APP}\vX.Y.Z".format(ORG=ORG_DIR, APP=APP_DIR),
            "fallback_current_localappdata": r"%LOCALAPPDATA%\{ORG}\{APP}\{CH}".format(ORG=ORG_DIR, APP=APP_DIR, CH=CHANNEL_DIR),
            "override_env_var": "REVIT_FINGERPRINT_ORG_DIR",
        },
        "tried": _tried,
        "dyn_candidates": _DYN_CANDIDATES,
        "dyn_probe_notes": _DYN_PROBE_NOTES,
        "notes": [
            "Do not run from UNC/network paths (\\\\server\\share\\...).",
            "SharePoint/OneDrive-synced paths are permitted but will emit a warning.",
            "Install the code locally, then run the Dynamo Player graph from SharePoint.",
            "Optional override: set REVIT_FINGERPRINT_REPO_DIR to your local install root.",
        ],
    }
else:
    REPO_DIR = _selected["repo_dir"]
    try:
        os.environ["REVIT_FINGERPRINT_REPO_ROOT_SELECTED"] = REPO_DIR
    except Exception:
        pass

    # Ensure this repo wins import resolution
    if REPO_DIR in sys.path:
        sys.path.remove(REPO_DIR)
    sys.path.insert(0, REPO_DIR)

    try:
        # Import triggers execution in this repo (run_dynamo computes OUT at import time)
        # Execute exactly once per invocation:
        # - first run: import
        # - subsequent runs: reload existing module
        # If an existing module is bound to a different repo root, drop it and import fresh.
        _existing = sys.modules.get("runner.run_dynamo", None)

        def _purge_repo_modules():
            prefixes = ("runner", "core", "domains")
            for _name in list(sys.modules.keys()):
                if (
                    _name in prefixes
                    or _name.startswith("runner.")
                    or _name.startswith("core.")
                    or _name.startswith("domains.")
                ):
                    sys.modules.pop(_name, None)

        if _existing is not None:
            try:
                _f = os.path.abspath(str(getattr(_existing, "__file__", "") or ""))
            except Exception:
                _f = ""
            if not _f.startswith(os.path.abspath(REPO_DIR) + os.sep):
                # Repo root switched: purge runner + dependencies so imports come
                # from the selected repo consistently.
                _purge_repo_modules()
                _existing = None

        if _existing is None:
            exporter = importlib.import_module("runner.run_dynamo")
        else:
            try:
                exporter = importlib.reload(_existing)
            except ModuleNotFoundError:
                # Some embedded hosts lose module spec metadata; fall back to fresh import.
                _purge_repo_modules()
                exporter = importlib.import_module("runner.run_dynamo")

        # Forward the computed OUT from the runner module
        OUT = exporter.OUT
        if _selected.get("warnings"):
            try:
                _out = OUT if isinstance(OUT, dict) else json.loads(OUT)
                _out.setdefault("_runner_warnings", []).extend(_selected["warnings"])
                OUT = json.dumps(_out, indent=2, sort_keys=True)
            except Exception:
                pass
        try:
            _out = OUT if isinstance(OUT, dict) else json.loads(OUT)
            _out["_thinrunner_repo_resolution"] = {
                "selected": {
                    "source": _selected.get("source"),
                    "repo_dir": REPO_DIR,
                },
                "dyn_candidates": _DYN_CANDIDATES,
                "dyn_probe_notes": _DYN_PROBE_NOTES,
                "tried": _tried,
            }
            OUT = json.dumps(_out, indent=2, sort_keys=True)
        except Exception:
            pass

    except Exception as e:
        OUT = {
            "status": "failed",
            "error": str(e),
            "traceback": traceback.format_exc(),
            "REPO_DIR": REPO_DIR,
            "repo_dir_source": _selected.get("source", None),
            "sys_path_head": sys.path[:8],
            "exporter_file": getattr(sys.modules.get("runner.run_dynamo", None), "__file__", None),
        }
# ----------------------------------------
watch = Watch(python_script_2)
watch_2 = Watch(python_script)
